# Requirement set Missile_Reqs (R2025b)

## 1 [RFP] Cost
Cost per missile will not exceed $500k

## 2 [RFP] Range
The range will be 500 nm from its launch to impact

## 3 [RFP] Cruise Speed

## 4 [RFP] Mark 41 VLS
Missile must be able to launch from Mark 41 VLS, Launch weight is less than 5000 lbm

## 5 [RFP]

## 6 [RFP]

## 7 [RFP]

## 8 [RFP]

## 9 [RFP]

## 10 [RFP]

## 11 [RFP]

## 12 [RFP]

## 13 [RFP]

## 14 [RFP]

## 15 [RFP]

## 16 [RFP]

## 17 [RFP]

## 18 [#18]

## 19 [#19]

## 20 [#20]

## 21 [#21]

## 22 [#22]

## 23 [#23]

## 24 [#24]

## 25 [#25]

## 26 [#26]

## 27 [#27]

## 28 [#28]

## 29 [#29]

## 30 [#30]

## 31 [#31]

## 32 [#32]

## 33 [#33]

## 34 [#34]